# Grasshopper definition GetData.gh (Grasshopper 1.0.8)
# plug-ins: RhinoCodePluginGH, Redback.GH

geo = Geometry(<brep referenced from the Rhino model>)
object = ModelObject(Object=geo)  # -> Object, Geometry, Name, Layer, Visibility, Display, Drafting, Render
layer_path = LayerPath(Layer=object.Layer)
objects = QueryModelObjects(Layer=layer_path, Locked=True, Hidden=True, AutoUpdateState=True)
item = ListItem(List=objects, Index=[0, 1, 2, 3], Wrap=True)
u_text = UserText(Content=item, Keys="id", UserTextMode=1)  # -> Content, Values
panel = Panel(u_text.Values)
object_2 = ModelObject(Object=graft(item))  # -> Object, Geometry
details = ContentDetails(Content=graft(item))  # -> Content, Id, Path, Attributes
serialize_geometry = SerializeGeometry(Geometry=object_2.Geometry, PR="{}")
py3 = Python3Script(u=Toggle(True), x=flatten(details.Id), z=flatten(u_text.Values), y=flatten(serialize_geometry))  # -> out, a; inputs x: list, z: list, y: list
# ---------- py3: Python ----------
import requests
a = []
if u:
    if not z:
        z = [None]*len(x)
    for u,v,w in zip(x,z,y):
        data = {"enabled":True, "identifier":u, "name":"Floor Slab"}

        if v:
            data["id"]= int(v)
        print(data)
        if "id" in data:
            r = requests.put("https://archmanucox.pythonanywhere.com/bimverse/nodes/%s/"%(int(v)), data=data)
        else:
            r = requests.post("https://archmanucox.pythonanywhere.com/bimverse/nodes/", data=data)
        print(r)
        #print(r.text)
        print(r.json())
        a.append(r.json()["id"])
# ---------- end py3 ----------
geo_2 = Geometry([<curve referenced from the Rhino model> x28])
u_text_2 = UserText(Content=graft(item), Keys="id", Values=graft(py3.a), UserTextMode=1)  # -> flatten(Content), Keys, Values
serialize_geometry_2 = Python3Script(GE=geo_2, PR="{}")  # -> out, JO; inputs GE: GeometryBase
# ---------- serialize_geometry_2: Python ----------
import json
if not PR:
    PR = "{}"

PR = json.loads(PR)

data = json.loads(GE.ToJSON(None))
data["properties"] = PR
#print(list(data))

JO = json.dumps(data)
# ---------- end serialize_geometry_2 ----------
serialize_geometry_3 = SerializeGeometry(Geometry=geo_2, PR="{}")
list = ValueList({"Rhino-Medium", "Rhino-Detailed", "LaserCutter"}, selected="Rhino-Detailed")
information = ContentInformation(Content=geo_2)  # -> Content, Parent, Name, Tags
panel_2 = Panel(py3.a)
details_2 = ContentDetails(Content=geo_2)  # -> Content, Id, Path, Attributes
cache = ContentCache(Content=u_text_2.Content, Action=Toggle(True))
py3_2 = Python3Script(index="1", x=list)  # -> out, a
# ---------- py3_2: Python ----------
# r: requests
import json
import requests

r = requests.get("http://archmanucox.pythonanywhere.com/bimverse/nodes/%s.json"%index)
data = r.json()

a = []

for i in data["geometryObjects"]:   
    if i["name"] == x:
        if type(i["geometry"]) == type([]):
            for g in i["geometry"]:
                a.append(json.dumps(g))
                appendObject = "list"
        else:
            appendObject= json.dumps(i["geometry"])

if not appendObject:
    appendObject= json.dumps(data[index]["geometryObjects"][0]["geometry"])
if appendObject != "list":
    a.append(appendObject)
# ---------- end py3_2 ----------
py3_3 = Python3Script()  # -> out, N, E
# ---------- py3_3: Python ----------
# r: requests
import json
import requests
import ghpythonlib as ghp

r = requests.get("http://localhost:8000/bimverse/edges/")
data = r.json()

#print(data)
nodes = []
edges = []
for i in data:
    if i["nodeObject_from"] not in nodes:
        nodes.append(i["nodeObject_from"])
    if i["nodeObject_to"] not in nodes:
        nodes.append(i["nodeObject_to"])
    f = nodes.index(i["nodeObject_from"])
    t = nodes.index(i["nodeObject_to"])
    edges.append([f,t])

N = nodes
E = ghp.treehelpers.list_to_tree(edges)
# ---------- end py3_3 ----------
deserialize_geometry_json = DeserializeGeometryJSON(Geometry=py3_2.a)  # -> JSONObject, PR
deserialize_geometry_json_2 = Python3Script(JO=py3_2.a)  # -> out, GE, PR; inputs JO: String
# ---------- deserialize_geometry_json_2: Python ----------
import json
import Rhino as rh

PR = json.dumps(json.loads(JO)["properties"])

GE = rh.Geometry.GeometryBase.FromJSON(JO)
# ---------- end deserialize_geometry_json_2 ----------
lng = ListLength(List=py3_3.N)
geo_3 = Geometry(deserialize_geometry_json.JSONObject)
pop2d = Populate2D(Region={Plane=PlaneXY(0, 0, 0), Size=Domain2(u=0..20, v=0..10)}, Count=lng, Seed=1)
object_3 = ModelObject(Geometry=geo_3)  # -> Object, Geometry, Name, Layer, Visibility, Display, Drafting, Render; disabled
item_2 = ListItem(List=pop2d, Index=py3_3.E, Wrap=True)
toggle = BooleanToggle(False)  # disabled
pline = PolyLine(Vertices=item_2, Closed=False)
cache_2 = ContentCache(Content=object_3.Object, Action=toggle)  # disabled
panel_3 = Panel(item_2)
